# Grasshopper definition 3assignment.gh (Grasshopper 1.0.7)

depth = Slider(4.599, range=0..8)
width = Slider(3.202, range=0..8)
depth_2 = Slider(8, range=0..10)
division = Division(A=width, B=-2)
circle = Circle(Plane=PlaneXY(0, 0, 0), Radius=Slider(13, range=0..20))
rectangle = Rectangle(Plane=PlaneXY(0, 0, 0), XSize=width, YSize=depth_2, Radius=0)  # -> Rectangle, Length
vector_xyz = VectorXYZ(XComponent=division, YComponent=depth, ZComponent=0)  # -> Vector, Length
move = Move(Geometry=rectangle.Rectangle, Motion=vector_xyz.Vector)  # -> Geometry, Transform
array_number = Slider(7, range=0..15)
polar_array = PolarArray(Geometry=move.Geometry, Plane=PlaneXY(0, 0, 0), Count=array_number, Angle=6.283185307)  # -> Geometry, Transform
group = Group(Objects=[polar_array.Geometry, circle])
