# Grasshopper definition grasshopperfirstmesh.gh (Grasshopper 1.0.7)

surface = Surface(<surface referenced from the Rhino model>)
divide_domain² = DivideDomain²(Domain=surface, UCount=Slider(13, range=1..20), VCount=Slider(11, range=1..20))
box = Box({Plane=Plane(origin=(-9, 0, 4), x=(0, 0, 1), y=(1, 0, 0)), X=Domain(0, 4), Y=Domain(0, 4), Z=Domain(0, 1)})
geometry = Geometry([<curve referenced from the Rhino model> x5])
surface_box = SurfaceBox(Surface=surface, Domain=divide_domain², Height=1)
box_morph = BoxMorph(Geometry=geometry, Reference=box, Target=surface_box)
