# Grasshopper definition lamp2.gh (Grasshopper 1.0.7)

curve = Curve(<curve referenced from the Rhino model>)
curve_2 = Curve(<curve referenced from the Rhino model>)
curve_3 = Curve(<curve referenced from the Rhino model>)
loft = Loft(
    Curves=[curve_2, curve, curve_3],
    Options={Adjust=False, Closed=False, LoftEnds=0, LoftSimp=0, LoftType=3, Rebuild=10, Refit=0.01})
deconstruct_brep = DeconstructBrep(Brep=loft)  # -> Faces, Edges, Vertices
panel = Panel(deconstruct_brep.Faces)
list_item = ListItem(List=deconstruct_brep.Faces, Index=Slider(0, range=0..1), Wrap=True)
list_item_2 = ListItem(List=deconstruct_brep.Faces, Index=Slider(1, range=0..2), Wrap=True)
surface = Surface(reparameterize(list_item))
surface_2 = Surface(reparameterize(list_item_2))
divide_domain² = DivideDomain²(Domain=surface, UCount=Slider(1, range=0..10), VCount=Slider(110, range=0..350))
divide_domain²_2 = DivideDomain²(Domain=surface_2, UCount=Slider(1, range=0..10), VCount=Slider(110, range=0..350))
isotrim = Isotrim(Surface=surface, Domain=divide_domain²)
isotrim_2 = Isotrim(Surface=surface_2, Domain=divide_domain²_2)
merge = Merge(Data1=Toggle(True), Data2=Toggle(False))
merge_2 = Merge(Data1=Toggle(True), Data2=Toggle(False))
cull_pattern = CullPattern(List=isotrim, CullPattern=merge)
panel_2 = Panel(merge)
cull_pattern_2 = CullPattern(List=isotrim_2, CullPattern=merge_2)
panel_3 = Panel(isotrim_2)
panel_4 = Panel(merge_2)
merge_3 = Merge(Data1=cull_pattern_2, Data2=cull_pattern)
