# Grasshopper definition octonest.gh (Grasshopper 1.0.7)

sides = Slider(8, range=0..12)
sides_2 = Slider(4, range=0..12)
polygon = Polygon(Plane=PlaneXY(0, 0, 0), Radius=sides_2, Segments=sides, FilletRadius=0)  # -> Polygon, Length
sides_3 = Slider(2, range=0..12)
sides_4 = Slider(3, range=0..12)
sides_5 = Slider(4, range=0..12)
sides_6 = Slider(1, range=0..12)
sides_7 = Slider(1, range=0..12)
sides_8 = Slider(1, range=0..12)
offset_curve = OffsetCurve(Curve=polygon.Polygon, Distance=sides_3, Plane=PlaneXY(0, 0, 0), Corners=1)
offset_curve_2 = OffsetCurve(Curve=polygon.Polygon, Distance=sides_4, Plane=PlaneXY(0, 0, 0), Corners=1)
offset_curve_3 = OffsetCurve(Curve=polygon.Polygon, Distance=sides_5, Plane=PlaneXY(0, 0, 0), Corners=1)
offset_curve_4 = OffsetCurve(Curve=polygon.Polygon, Distance=sides_6, Plane=PlaneXY(0, 0, 0), Corners=1)
offset_curve_5 = OffsetCurve(Curve=polygon.Polygon, Distance=sides_7, Plane=PlaneXY(0, 0, 0), Corners=1)
offset_curve_6 = OffsetCurve(Curve=polygon.Polygon, Distance=sides_8, Plane=PlaneXY(0, 0, 0), Corners=1)
group = Group([offset_curve, offset_curve_6, offset_curve_2, offset_curve_3, offset_curve_4, offset_curve_5])
